# Grasshopper definition Day1_Ex1.gh (Grasshopper 1.0.7)
# plug-ins: LunchBox, Kangaroo2 Components

number_slider = Slider(50, range=0..100)
# 2. Form-Found Surface
srf = Surface(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)
mesh_uv = MeshSurface(Surface=srf, UCount=number_slider, VCount=number_slider, Overhang=True, Equalize=False)
medges = MeshEdges(Mesh=mesh_uv)  # -> NakedEdges, InteriorEdges, NonManifoldEdges
mc = MeshCorners(Mesh=mesh_uv, Angle=2.35619449)
pt = Point([Point(-11.78566739, -17.33625393, 0), Point(-16.53159385, 100.9447375, 22.59819103), Point(83.98729852, 104.3548561, 37.79064792), Point(93.45757079, 12.32048304, -30.10512209)])
anchor = Anchor(Point=mc, Target=pt, Strength=10000)
length_line = LengthLine(Line=[medges.NakedEdges, medges.InteriorEdges], Length=Slider(0.556, range=0..1), Strength=10)
show = Show(G=mesh_uv)
entwine = Entwine(Branch00=show, Branch01=length_line, Branch02=anchor, FlattenInputs=True)
solver = Solver(GoalObjects=entwine, Reset=Button(), Threshold=1e-15, Tolerance=0.0001, On=Toggle(True))  # -> I, V, O
branch = TreeBranch(Tree=simplify(solver.O), Path="0", MaintainPaths=True)
demesh = DeconstructMesh(Mesh=branch)  # -> Vertices, Faces, Colours, Normals
srfgrid = SurfaceFromPoints(Points=demesh.Vertices, UCount=expr("x+1", number_slider), Interpolate=False)
srf_cp = SurfaceClosestPoint(Point=demesh.Vertices, Surface=srfgrid)  # -> Point, UVPoint, Distance; disabled
curvature = SurfaceCurvature(Surface=srfgrid, Point=srf_cp.UVPoint)  # -> Frame, Gaussian, Mean; disabled

paraboloid = HyperbolicParaboloid(U=100, V=100, a=2, b=2, S=5, D1=Domain(-4, 4), D2=Domain(-4, 4))
torus = TorusSurface(
    UDivisions=90,
    VDivisions=96,
    CParameter=4,
    RParameter=2,
    TParameter=1,
    Scale=5,
    Domain1=Domain(0, 6.283185307),
    Domain2=Domain(-3.141592654, 3.141592654))
helicoid = HelicoidSurface(
    UDivisions=100,
    VDivisions=100,
    RParameter=2,
    TParameter=1,
    Scale=5,
    Domain1=Domain(-6.283185307, 6.283185307),
    Domain2=Domain(-3.141592654, 3.141592654))

gradient = Gradient(
    LowerLimit=0,
    UpperLimit=1,
    Parameter=curvature.Mean,
    stops=[0: RGB(234, 38, 0), 0.25: RGB(234, 126, 0), 0.5: RGB(254, 244, 84), 0.75: RGB(173, 203, 249), 1: RGB(75, 107, 169)])  # disabled
mcol = MeshColours(Mesh=branch, Colours=gradient)  # disabled

# ----
# Ennaper Class 2 - wolfram
# u
# resulting points
# Number of points = resolution
# parameters (domain; lowest to highest) of v
# v
number_slider_2 = Slider(1, range=0..1)
pi = Pi(Factor=1)
pi_2 = Pi(Factor=1)
neg = Negative(Value=pi)
number_slider_3 = Slider(100, range=0..100)
dom = ConstructDomain(DomainStart=neg, DomainEnd=pi_2)
dom_2 = ConstructDomain(DomainStart="0", DomainEnd=number_slider_2)
range_v = Range(Domain=dom, Steps=number_slider_3)
range_u = Range(Domain=dom_2, Steps=number_slider_3)
crossref = CrossReference(ListA=range_u, ListB=range_v, CrossMode=1)  # -> ListA, ListB
lng = ListLength(List=range_v)

# ---- group: try differrent formulas here
expression = Expression(u=crossref.ListA, v=crossref.ListB, a="4", Expression="a*(-u/3)*(3*sin(v)+u²*sin(3*v))")
expression_2 = Expression(u=crossref.ListA, v=crossref.ListB, a="4", Expression="a*(u*cos(v)-u³/3*cos(3*v))")
expression_3 = Expression(u=crossref.ListA, v=crossref.ListB, a="4", Expression="a*u²*cos(2*v)")

# ----
pt_2 = ConstructPoint(XCoordinate=expression_2, YCoordinate=expression, ZCoordinate=expression_3)
srfgrid_2 = SurfaceFromPoints(Points=pt_2, UCount=lng, Interpolate=False)

# ----
# OPTIshell © 2024 by Judy Curie, Szymon Loj is licensed under CC BY-NC-SA 4.0
# “© Judy Curie, Szymon Loj, 2024.
# adopted from Eike Schling
# 
# This work may be reproduced, modified, distributed, performed and displayed for any purpose, but must acknowledge “OPTIshell”.
# Copyright is retained and must be preserved. The work is provided as is; no warranty is provided, and users accept all liability.”
# 1. Matematical Surfaces
number_slider_4 = Slider(3, range=0..10)
enneper = EnneperSurface(
    UDivisions=100,
    VDivisions=100,
    RParameter=number_slider_4,
    Scale=Slider(5, range=0..10),
    Domain1=Domain(0, 1),
    Domain2=Domain(-3.141592654, 3.141592654))

rotate = Rotate(Geometry=enneper, Angle=degrees(Slider(60, range=0..1000)), Plane=PlaneXY(0, 0, 0))  # -> Geometry, Transform
minimal_surface = Surface(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)

minimal_surface_2 = Surface(rotate.Geometry)
