# Grasshopper definition Day1_Ex2.gh (Grasshopper 1.0.7)
# plug-ins: Pufferfish

md_slider = MDSlider(
    SliderMode=0,
    slider_value=Point(0.2555718306, 0.4320354927, 0.5),
    x_domain=Domain(0, 1),
    y_domain=Domain(0, 1),
    z_domain=Domain(0, 1))
# OPTIshell © 2024 by Judy Curie, Szymon Loj is licensed under CC BY-NC-SA 4.0
# “© Judy Curie, Szymon Loj, 2024.
# adopted from Eike Schling
# 
# This work may be reproduced, modified, distributed, performed and displayed for any purpose, but must acknowledge “OPTIshell”.
# Copyright is retained and must be preserved. The work is provided as is; no warranty is provided, and users accept all liability.”
# Surface analysis
# Determining if the surface is synclastic or anticlastic (main curvatures going in the opposite directions)
minimalsurface = Surface(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)
freeformsurface = Surface(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)
# Determining if the surface is minimal or at least close to minimal (Mean curvature = 0) ((K1 + K2) / 2 = 0)
minimalsurface_2 = Surface(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)
freeformsurface_2 = Surface(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)

# ---- group: Freeform
number_slider = Slider(100, range=0..100)
mesh_uv = MeshSurface(Surface=freeformsurface, UCount=number_slider, VCount=number_slider, Overhang=True, Equalize=False)
mesh = Mesh(mesh_uv)
facen = FaceNormals(Mesh=mesh)  # -> Centers, Normals
srf_cp = SurfaceClosestPoint(Point=facen.Centers, Surface=freeformsurface_2)  # -> Point, UVPoint, Distance
curvature = SurfaceCurvature(Surface=freeformsurface_2, Point=srf_cp.UVPoint)  # -> Frame, Gaussian, Mean
gradient = Gradient(
    LowerLimit="0",
    UpperLimit="1",
    Parameter=curvature.Mean,
    stops=[0: RGB(234, 38, 0), 0.25: RGB(234, 126, 0), 0.5: RGB(254, 244, 84), 0.75: RGB(173, 203, 249), 1: RGB(75, 107, 169)])
mcol = MeshColours(Mesh=mesh, Colours=gradient)

# ----
evalsrf = EvaluateSurface(Surface=reparameterize(minimalsurface), Point=md_slider)  # -> Point, Normal, UDirection, VDirection, Frame
popgeo = PopulateGeometry(Geometry=minimalsurface, Count=100, Seed=1)
popgeo_2 = PopulateGeometry(Geometry=freeformsurface, Count=100, Seed=1)
popgeo_3 = PopulateGeometry(Geometry=minimalsurface_2, Count=100, Seed=1)
popgeo_4 = PopulateGeometry(Geometry=freeformsurface_2, Count=100, Seed=1)
# Curve analysis
asymptoticcurves = Curve([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])
srf_cp_2 = SurfaceClosestPoint(Point=popgeo, Surface=minimalsurface)  # -> Point, UVPoint, Distance
srf_cp_3 = SurfaceClosestPoint(Point=popgeo_2, Surface=freeformsurface)  # -> Point, UVPoint, Distance
minimalsurface_3 = Surface(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)
srf_cp_4 = SurfaceClosestPoint(Point=evalsrf.Point, Surface=minimalsurface)  # -> Point, UVPoint, Distance

# ---- group: Enepper
mesh_2 = Mesh(minimalsurface)
# Mean curvature visualization (is minimal?)
facen_2 = FaceNormals(Mesh=mesh_2)  # -> Centers, Normals
srf_cp_5 = SurfaceClosestPoint(Point=facen_2.Centers, Surface=freeformsurface_2)  # -> Point, UVPoint, Distance
curvature_2 = SurfaceCurvature(Surface=freeformsurface_2, Point=srf_cp_5.UVPoint)  # -> Frame, Gaussian, Mean
gradient_2 = Gradient(
    LowerLimit="0",
    UpperLimit="1",
    Parameter=curvature_2.Mean,
    stops=[0: RGB(234, 38, 0), 0.25: RGB(234, 126, 0), 0.5: RGB(254, 244, 84), 0.75: RGB(173, 203, 249), 1: RGB(75, 107, 169)])
mcol_2 = MeshColours(Mesh=mesh_2, Colours=gradient_2)

# ----
srf_cp_6 = SurfaceClosestPoint(Point=popgeo_3, Surface=minimalsurface_2)  # -> Point, UVPoint, Distance
srf_cp_7 = SurfaceClosestPoint(Point=popgeo_4, Surface=freeformsurface_2)  # -> Point, UVPoint, Distance
mesh_3 = Mesh(minimalsurface_3)
edges = BrepEdges(Brep=minimalsurface_3)  # -> Naked, Interior, NonManifold
curvature_3 = SurfaceCurvature(Surface=minimalsurface, Point=srf_cp_4.UVPoint)  # -> Frame, Gaussian, Mean
curvature_4 = SurfaceCurvature(Surface=freeformsurface, Point=srf_cp_3.UVPoint)  # -> Frame, Gaussian, Mean

# ---- group: Main curvatures (principal)
curvature_5 = PrincipalCurvature(Surface=minimalsurface, Point=srf_cp_4.UVPoint)  # -> Frame, Maximum, Minimum, MaxDirection, MinDirection
panel = Panel(curvature_5.Maximum)
panel_2 = Panel(curvature_5.Minimum)

curvature_6 = PrincipalCurvature(Surface=freeformsurface, Point=srf_cp_3.UVPoint)  # -> Frame, Maximum, Minimum, MaxDirection, MinDirection
panel_3 = Panel(curvature_6.Maximum)
panel_4 = Panel(curvature_6.Minimum)

# ----
# Curvature visualization - graph
culln = CullNth(List=asymptoticcurves, CullFrequency=2)
demesh = DeconstructMesh(Mesh=mesh_3)  # -> Vertices, Faces, Colours, Normals
curvature_7 = SurfaceCurvature(Surface=minimalsurface_2, Point=srf_cp_6.UVPoint)  # -> Frame, Gaussian, Mean
curvature_8 = SurfaceCurvature(Surface=freeformsurface_2, Point=srf_cp_7.UVPoint)  # -> Frame, Gaussian, Mean
curvature_9 = PrincipalCurvature(Surface=minimalsurface_2, Point=srf_cp_6.UVPoint)  # -> Frame, Maximum, Minimum, MaxDirection, MinDirection
curvature_10 = PrincipalCurvature(Surface=freeformsurface_2, Point=srf_cp_7.UVPoint)  # -> Frame, Maximum, Minimum, MaxDirection, MinDirection
number_slider_2 = Slider(100, range=0..100)
curvepoint = PointOnCurve(edges.Naked, parameter=0.376)
panel_5 = Panel(curvature_4.Gaussian)
curvepoint_2 = PointOnCurve(edges.Naked, parameter=0.81)
panel_6 = Panel(curvature_3.Gaussian)
srfgrid = SurfaceFromPoints(Points=demesh.Vertices, UCount=Slider(100, range=0..100), Interpolate=False)

# ---- group: Mean curvature calculation
addition = Addition(A=curvature_9.Maximum, B=curvature_9.Minimum)
panel_7 = Panel(addition)
division = Division(A=panel_7, B="2")

addition_2 = Addition(A=curvature_10.Maximum, B=curvature_10.Minimum)
panel_8 = Panel(addition_2)
division_2 = Division(A=panel_8, B="2")

# ----
geodesic = Geodesic(Surface=minimalsurface_3, Start=curvepoint, End=curvepoint_2)
c_script = CSharpScript(value1=panel, value2=panel_2)  # -> out, A, B; inputs value1: list of Double, value2: list of Double
# ---------- c_script: C# ----------
    A = Check(value1);
    B = Check(value2);
# ---------- c_script: C# additional code ----------
  List<string> Check(List<double> values)
  {
    List<string> results = new List<string>();
    string val = string.Empty;
    foreach (double item in values)
    {
      if(item <= 0){
        val = "-";
        results.Add(val);}
      else{
        val = "+";
        results.Add(val);
      }
    }
    return results;
  }
# ---------- end c_script ----------
c_script_2 = CSharpScript(value1=panel_3, value2=panel_4)  # -> out, A, B; inputs value1: list of Double, value2: list of Double; same code as c_script
# If the curve is geodesic
# the graph will align with
# the torsion vectors
crvgraph = CurvatureGraph(Curve=geodesic, Density=5, Scale=number_slider_2)

# ---- group: Anticlasticc
panel_9 = Panel(c_script.A)
panel_10 = Panel(c_script.B)

# ---- group: Synclastic
panel_11 = Panel(c_script_2.A)
panel_12 = Panel(c_script_2.B)

# ----
panel_13 = Panel(curvature_7.Mean)
panel_14 = Panel(curvature_8.Mean)
panel_15 = Panel(division_2)
panel_16 = Panel(division)

# ---- group: pricipal
number_slider_3 = Slider(72, range=0..100)
angle = Slider(-90, range=-90..90)
angle_2 = Slider(0, range=-90..90)
item = ListItem(List=srf_cp_3.UVPoint, Index=number_slider_3, Wrap=True)
list = ValueList({"Euler": 1, "Modified Euler": 2, "RK4": 3}, selected="Euler")
rad = Radians(Degrees=[angle, angle_2])
vb = VBScript(srf=freeformsurface, uv=item, accuracy=Slider(0.03, range=0..10), angle=rad, max=graft("True"), alg=list)  # -> out, simplify(pts); inputs srf: Surface, uv: Point3d
# ---------- vb: VB ----------
    If (srf Is Nothing) Then Return
    If (Not uv.IsValid) Then Return

    'Limit the accuracy to the document tolerance.
    accuracy = Math.Max(accuracy, doc.ModelAbsoluteTolerance)

    'Declare our list of samples.
    Dim dir0 As List(Of Point3d) = SampleCurvature(srf, uv, accuracy, max, angle, alg)
    Dim dir1 As List(Of Point3d) = SampleCurvature(srf, uv, accuracy, max, angle + Math.PI, alg)

    'Remove the first point in dir1 as it's a duplicate
    dir1.RemoveAt(0)
    dir1.Reverse()

    dir1.AddRange(dir0)
    pts = dir1
# ---------- vb: VB additional code ----------
  Private Function SampleCurvature(ByVal srf As Surface, ByVal uv As Point3d, ByVal accuracy As Double, ByVal max As Boolean, ByVal angle As Double, ByVal alg As Integer) As List(Of Point3d)
    Dim p As Point3d = uv
    Dim U As Interval = srf.Domain(0)
    Dim V As Interval = srf.Domain(1)

    Dim samples As New List(Of Point3d)
    Do
      'Add the current point.
      samples.Add(srf.PointAt(p.X, p.Y))

      '####################################
      '##### Euler/Modified Euler/RK4 #####
      '####################################
      Dim dir As Vector3D
      
      Select Case alg
        Case 1
          dir = Euler(srf, p, max, angle, accuracy, samples)
        Case 2
          dir = ModEuler(srf, p, max, angle, accuracy, samples)
        Case 3
          dir = RK4(srf, p, max, angle, accuracy, samples)
        Case Else
          Print("Choose a 'alg' number from 1 to 3")
      End Select

      If (IsNothing(dir)) Then Exit Do

      Dim s, t As Double
      Dim pt As Point3d = samples(samples.Count - 1) + dir
      If (Not srf.ClosestPoint(pt, s, t)) Then Exit Do

      '##################
      '##### Checks #####
      '##################
      'Abort if we've added more than 10,000 samples.
      If (samples.Count > 9999) Then Exit Do

      'Abort if we've wandered beyond the surface edge.
      If (Not U.IncludesParameter(s, True)) Then Exit Do
      If (Not V.IncludesParameter(t, True)) Then Exit Do

      'Abort if the new point is basically the same as the old point.
      If (Math.Abs(p.X - s) < 1e-12) AndAlso (Math.Abs(p.Y - t) < 1e-12) Then Exit Do

      p.X = s
      p.Y = t
    Loop

    Return samples
  End Function

  Private Function GetDir(ByVal srf As Surface, ByVal p As Point3d, ByVal max As Boolean, ByVal angle As Double, ByVal h As Double, ByVal PrevDir As Vector3d) As Vector3d
    'Get the curvature at the current point.
    Dim crv As SurfaceCurvature = srf.CurvatureAt(p.X, p.Y)
    If (crv Is Nothing) Then Return Nothing

    'Get the maximum principal direction.
    Dim dir As Vector3d
    If (crv.Kappa(0) > crv.Kappa(1)) Then
      If (max) Then
        dir = crv.Direction(0)
      Else
        dir = crv.Direction(1)
      End If
    Else
      If (max) Then
        dir = crv.Direction(1)
      Else
        dir = crv.Direction(0)
      End If
    End If

    dir.Rotate(angle, crv.Normal)

    If (Not dir.IsValid) Then Return Nothing
    If (Not dir.Unitize()) Then Return Nothing

    'Scale the direction vector to match our accuracy.
    dir *= h

    'Flip the direction 180 degrees if it seems to be going backwards
    If (Not IsNothing(PrevDir)) Then
      If (dir.IsParallelTo(PrevDir, 0.5 * Math.PI) < 0) Then
        dir.Reverse()
      End If
    End If

    Return dir
  End Function

  Private Function Euler(ByVal srf As Surface, ByVal p As Point3d, ByVal max As Boolean, ByVal angle As Double, ByVal h As Double, ByVal samples As List(Of Point3d)) As Vector3d
    Dim N As Integer = samples.Count
    Dim PrevDir As Vector3d
    If (N > 1) Then
      PrevDir = samples(N - 1) - samples(N - 2)
    End If

    Dim dir As Vector3D = GetDir(srf, p, max, angle, h, PrevDir)
    If (IsNothing(dir)) Then Return Nothing

    Return dir
  End Function

  Private Function ModEuler(ByVal srf As Surface, ByVal p As Point3d, ByVal max As Boolean, ByVal angle As Double, ByVal h As Double, ByVal samples As List(Of Point3d)) As Vector3d
    Dim N As Integer = samples.Count
    Dim PrevDir As Vector3d
    If (N > 1) Then
      PrevDir = samples(N - 1) - samples(N - 2)
    End If

    Dim dir1 As Vector3D = GetDir(srf, p, max, angle, h, PrevDir)
    If (IsNothing(dir1)) Then Return Nothing

    'Move the last point in the list along the curvature direction.
    Dim pt As Point3d = samples(samples.Count - 1) + dir1

    Dim s, t As Double
    If (Not srf.ClosestPoint(pt, s, t)) Then Return Nothing
    pt.X = s
    pt.Y = t

    Dim dir2 As Vector3D = GetDir(srf, pt, max, angle, h, dir1)
    If (IsNothing(dir2)) Then Return Nothing

    Dim dir As Vector3D = (dir1 + dir2) * 0.5
    Return dir
  End Function

  Private Function RK4(ByVal srf As Surface, ByVal p As Point3d, ByVal max As Boolean, ByVal angle As Double, ByVal h As Double, ByVal samples As List(Of Point3d)) As Vector3d
    Dim N As Integer = samples.Count
    Dim PrevDir As Vector3d
    If (N > 1) Then
      PrevDir = samples(N - 1) - samples(N - 2)
    End If

    Dim K1 As Vector3D = GetDir(srf, p, max, angle, h, PrevDir)
    If (IsNothing(K1)) Then Return Nothing

    'Move the last point in the list along the curvature direction.
    Dim pt1 As Point3d = samples(samples.Count - 1) + K1 * 0.5

    Dim s, t As Double
    If (Not srf.ClosestPoint(pt1, s, t)) Then Return Nothing
    pt1.X = s
    pt1.Y = t

    Dim K2 As Vector3D = GetDir(srf, pt1, max, angle, h, K1)
    If (IsNothing(K2)) Then Return Nothing

    Dim pt2 As Point3d = samples(samples.Count - 1) + K2 * 0.5

    If (Not srf.ClosestPoint(pt2, s, t)) Then Return Nothing
    pt2.X = s
    pt2.Y = t

    Dim K3 As Vector3D = GetDir(srf, pt2, max, angle, h, K1)
    If (IsNothing(K3)) Then Return Nothing

    Dim pt3 As Point3d = samples(samples.Count - 1) + K3

    If (Not srf.ClosestPoint(pt3, s, t)) Then Return Nothing
    pt3.X = s
    pt3.Y = t

    Dim K4 As Vector3D = GetDir(srf, pt3, max, angle, h, K1)
    If (IsNothing(K4)) Then Return Nothing

    Dim dir As Vector3D = 1 / 6 * (K1 + 2 * K2 + 2 * K3 + K4)
    Return dir
  End Function
# ---------- end vb ----------
pline = PolyLine(Vertices=vb.pts, Closed=False)

# ----
item_2 = ListItem(List=srf_cp_4.UVPoint, Index=number_slider_3, Wrap=True)
# Round value recommended
# to compare if the surface
# is minimal (tolerance issue)
panel_17 = Panel("2")

# ---- group: principal
angle_3 = Slider(-90, range=-90..90)
angle_4 = Slider(0, range=-90..90)
list_2 = ValueList({"Euler": 1, "Modified Euler": 2, "RK4": 3}, selected="Euler")
toggle = BooleanToggle(False)
rad_2 = Radians(Degrees=[angle_3, angle_4])
vb_2 = VBScript(srf=minimalsurface, uv=item_2, accuracy=Slider(0.03, range=0..10), angle=rad_2, max=graft("True"), alg=list_2)  # -> out, simplify(pts); inputs srf: Surface, uv: Point3d
# ---------- vb_2: VB usings ----------
Imports System.IO
Imports System.Linq
Imports System.Data
Imports System.Drawing
Imports System.Reflection
Imports System.Windows.Forms
Imports System.Xml
Imports System.Xml.Linq
Imports Microsoft.VisualBasic
Imports System.Runtime.InteropServices

Imports Rhino.DocObjects
Imports Rhino.Collections
Imports GH_IO
Imports GH_IO.Serialization
# ---------- vb_2: VB ----------
    If (srf Is Nothing) Then Return
    If (Not uv.IsValid) Then Return

    'Limit the accuracy to the document tolerance.
    accuracy = Math.Max(accuracy, doc.ModelAbsoluteTolerance)

    'Declare our list of samples.
    Dim dir0 As List(Of Point3d) = SampleCurvature(srf, uv, accuracy, max, angle, alg)
    Dim dir1 As List(Of Point3d) = SampleCurvature(srf, uv, accuracy, max, angle + Math.PI, alg)

    'Remove the first point in dir1 as it's a duplicate
    dir1.RemoveAt(0)
    dir1.Reverse()

    dir1.AddRange(dir0)
    pts = dir1
# ---------- vb_2: VB additional code ----------
  Private Function SampleCurvature(ByVal srf As Surface, ByVal uv As Point3d, ByVal accuracy As Double, ByVal max As Boolean, ByVal angle As Double, ByVal alg As Integer) As List(Of Point3d)
    Dim p As Point3d = uv
    Dim U As Interval = srf.Domain(0)
    Dim V As Interval = srf.Domain(1)

    Dim samples As New List(Of Point3d)
    Do
      'Add the current point.
      samples.Add(srf.PointAt(p.X, p.Y))

      '####################################
      '##### Euler/Modified Euler/RK4 #####
      '####################################
      Dim dir As Vector3D

      Select Case alg
        Case 1
          dir = Euler(srf, p, max, angle, accuracy, samples)
        Case 2
          dir = ModEuler(srf, p, max, angle, accuracy, samples)
        Case 3
          dir = RK4(srf, p, max, angle, accuracy, samples)
        Case Else
          Print("Choose a 'alg' number from 1 to 3")
      End Select

      If (IsNothing(dir)) Then Exit Do

      Dim s, t As Double
      Dim pt As Point3d = samples(samples.Count - 1) + dir
      If (Not srf.ClosestPoint(pt, s, t)) Then Exit Do

      '##################
      '##### Checks #####
      '##################
      'Abort if we've added more than 10,000 samples.
      If (samples.Count > 9999) Then Exit Do

      'Abort if we've wandered beyond the surface edge.
      If (Not U.IncludesParameter(s, True)) Then Exit Do
      If (Not V.IncludesParameter(t, True)) Then Exit Do

      'Abort if the new point is basically the same as the old point.
      If (Math.Abs(p.X - s) < 1e-12) AndAlso (Math.Abs(p.Y - t) < 1e-12) Then Exit Do

      p.X = s
      p.Y = t
    Loop

    Return samples
  End Function

  Private Function GetDir(ByVal srf As Surface, ByVal p As Point3d, ByVal max As Boolean, ByVal angle As Double, ByVal h As Double, ByVal PrevDir As Vector3d) As Vector3d
    'Get the curvature at the current point.
    Dim crv As SurfaceCurvature = srf.CurvatureAt(p.X, p.Y)
    If (crv Is Nothing) Then Return Nothing

    'Get the maximum principal direction.
    Dim dir As Vector3d
    If (crv.Kappa(0) > crv.Kappa(1)) Then
      If (max) Then
        dir = crv.Direction(0)
      Else
        dir = crv.Direction(1)
      End If
    Else
      If (max) Then
        dir = crv.Direction(1)
      Else
        dir = crv.Direction(0)
      End If
    End If

    dir.Rotate(angle, crv.Normal)

    If (Not dir.IsValid) Then Return Nothing
    If (Not dir.Unitize()) Then Return Nothing

    'Scale the direction vector to match our accuracy.
    dir *= h

    'Flip the direction 180 degrees if it seems to be going backwards
    If (Not IsNothing(PrevDir)) Then
      If (dir.IsParallelTo(PrevDir, 0.5 * Math.PI) < 0) Then
        dir.Reverse()
      End If
    End If

    Return dir
  End Function

  Private Function Euler(ByVal srf As Surface, ByVal p As Point3d, ByVal max As Boolean, ByVal angle As Double, ByVal h As Double, ByVal samples As List(Of Point3d)) As Vector3d
    Dim N As Integer = samples.Count
    Dim PrevDir As Vector3d
    If (N > 1) Then
      PrevDir = samples(N - 1) - samples(N - 2)
    End If

    Dim dir As Vector3D = GetDir(srf, p, max, angle, h, PrevDir)
    If (IsNothing(dir)) Then Return Nothing

    Return dir
  End Function

  Private Function ModEuler(ByVal srf As Surface, ByVal p As Point3d, ByVal max As Boolean, ByVal angle As Double, ByVal h As Double, ByVal samples As List(Of Point3d)) As Vector3d
    Dim N As Integer = samples.Count
    Dim PrevDir As Vector3d
    If (N > 1) Then
      PrevDir = samples(N - 1) - samples(N - 2)
    End If

    Dim dir1 As Vector3D = GetDir(srf, p, max, angle, h, PrevDir)
    If (IsNothing(dir1)) Then Return Nothing

    'Move the last point in the list along the curvature direction.
    Dim pt As Point3d = samples(samples.Count - 1) + dir1

    Dim s, t As Double
    If (Not srf.ClosestPoint(pt, s, t)) Then Return Nothing
    pt.X = s
    pt.Y = t

    Dim dir2 As Vector3D = GetDir(srf, pt, max, angle, h, dir1)
    If (IsNothing(dir2)) Then Return Nothing

    Dim dir As Vector3D = (dir1 + dir2) * 0.5
    Return dir
  End Function

  Private Function RK4(ByVal srf As Surface, ByVal p As Point3d, ByVal max As Boolean, ByVal angle As Double, ByVal h As Double, ByVal samples As List(Of Point3d)) As Vector3d
    Dim N As Integer = samples.Count
    Dim PrevDir As Vector3d
    If (N > 1) Then
      PrevDir = samples(N - 1) - samples(N - 2)
    End If

    Dim K1 As Vector3D = GetDir(srf, p, max, angle, h, PrevDir)
    If (IsNothing(K1)) Then Return Nothing

    'Move the last point in the list along the curvature direction.
    Dim pt1 As Point3d = samples(samples.Count - 1) + K1 * 0.5

    Dim s, t As Double
    If (Not srf.ClosestPoint(pt1, s, t)) Then Return Nothing
    pt1.X = s
    pt1.Y = t

    Dim K2 As Vector3D = GetDir(srf, pt1, max, angle, h, K1)
    If (IsNothing(K2)) Then Return Nothing

    Dim pt2 As Point3d = samples(samples.Count - 1) + K2 * 0.5

    If (Not srf.ClosestPoint(pt2, s, t)) Then Return Nothing
    pt2.X = s
    pt2.Y = t

    Dim K3 As Vector3D = GetDir(srf, pt2, max, angle, h, K1)
    If (IsNothing(K3)) Then Return Nothing

    Dim pt3 As Point3d = samples(samples.Count - 1) + K3

    If (Not srf.ClosestPoint(pt3, s, t)) Then Return Nothing
    pt3.X = s
    pt3.Y = t

    Dim K4 As Vector3D = GetDir(srf, pt3, max, angle, h, K1)
    If (IsNothing(K4)) Then Return Nothing

    Dim dir As Vector3D = 1 / 6 * (K1 + 2 * K2 + 2 * K3 + K4)
    Return dir
  End Function
# ---------- end vb_2 ----------
pline_2 = PolyLine(Vertices=vb_2.pts, Closed=False)

# ---- group: asymptotic
angle_5 = Slider(1.75, range=-90..90)
panel_18 = Panel("""True
False""")
rad_3 = Radians(Degrees=angle_5)
vb_3 = VBScript(srf=minimalsurface, uv=item_2, accuracy=Slider(0.26, range=0..10), angle=rad_3, max=graft(panel_18))  # -> out, pts; inputs srf: Surface, uv: Point3d
# ---------- vb_3: VB ----------
    If (srf Is Nothing) Then Return
    If (Not uv.IsValid) Then Return

    'Limit the accuracy to the document tolerance.
    accuracy = Math.Max(accuracy, doc.ModelAbsoluteTolerance)

    'Declare our list of samples.
    Dim dir0 As List(Of Point3d) = SampleCurvature(srf, uv, accuracy, max, angle)
    Dim dir1 As List(Of Point3d) = SampleCurvature(srf, uv, accuracy, max, angle + Math.PI)

    'Remove the first point in dir1 as it's a duplicate
    dir1.RemoveAt(0)
    dir1.Reverse()

    dir1.AddRange(dir0)
    pts = dir1
# ---------- vb_3: VB additional code ----------
  Private Function SampleCurvature(ByVal srf As Surface, ByVal uv As Point3d, ByVal accuracy As Double, ByVal max As Boolean, ByVal angle As Double) As List(Of Point3d)
    Dim p As Point3d = uv
    Dim U As Interval = srf.Domain(0)
    Dim V As Interval = srf.Domain(1)

    Dim samples As New List(Of Point3d)
    Do
      'Abort if we've added more than 10,000 samples
      If (samples.Count > 10000) Then Exit Do

      'Get the curvature at the current point
      Dim crv As SurfaceCurvature = srf.CurvatureAt(p.X, p.Y)
      If (crv Is Nothing) Then Exit Do

      'Add the current point
      samples.Add(srf.PointAt(p.X, p.Y))

      'Get the maximum principal direction & values
      Dim dir As Vector3d
      Dim k1 = 0
      Dim k2 = 0
      If (crv.Kappa(0) > crv.Kappa(1)) Then
        If (max) Then
          dir = crv.Direction(0)
          k1 = crv.Kappa(0)
          k2 = crv.Kappa(1)
        Else
          dir = crv.Direction(1)
          k1 = crv.Kappa(1)
          k2 = crv.Kappa(0)
        End If
      Else
        If (max) Then
          dir = crv.Direction(1)
          k1 = crv.Kappa(1)
          k2 = crv.Kappa(0)
        Else
          dir = crv.Direction(0)
          k1 = crv.Kappa(0)
          k2 = crv.Kappa(1)
        End If
      End If


      'check if you are on an anticlastic surface, if not: Exit
      If (k1 * k2 > 0) Then Exit Do

      'Calculate alpha, which is the deviation between A-direction to PC-direction

      Dim alpha1 As Double
      Dim alpha2 As Double
      alpha1 = (2 * Math.ATan(Math.Sqrt((2 * Math.Sqrt(k2 * ( -(k1 - k2))) + k1 - (2 * k2)) / k1)))
      alpha2 = (2 * Math.ATan(Math.Sqrt((-2 * Math.Sqrt(k2 * ( -(k1 - k2))) + k1 - (2 * k2)) / k1)))

      'apply aplpha to the PC-direction to get A-direction
      If (max) Then
        dir.Rotate(-alpha1, crv.Normal)
      Else
        dir.Rotate(-alpha2, crv.Normal)
      End If


      'optional additional angle!
      dir.Rotate(angle, crv.Normal)

      If (Not dir.IsValid) Then Exit Do
      If (Not dir.Unitize()) Then Exit Do

      'Scale the direction vector to match our accuracy.
      dir *= accuracy

      'Flip the direction 180 degrees if it seems to be going backwards
      Dim N As Integer = samples.Count
      If (N > 1) Then
        If (dir.IsParallelTo(samples(N - 1) - samples(N - 2), 0.5 * Math.PI) < 0) Then
          dir.Reverse()
        End If
      End If

      'Move the last point in the list along the curvature direction.
      Dim pt As Point3d = samples(samples.Count - 1) + dir

      Dim s, t As Double
      If (Not srf.ClosestPoint(pt, s, t)) Then Exit Do

      'Abort if we've wandered beyond the surface edge.
      If (Not U.IncludesParameter(s, True)) Then Exit Do
      If (Not V.IncludesParameter(t, True)) Then Exit Do

      'Abort if the new point is basically the same as the old point.
      If (Math.Abs(p.X - s) < 1e-12) AndAlso (Math.Abs(p.Y - t) < 1e-12) Then Exit Do

      p.X = s
      p.Y = t
    Loop

    Return samples
  End Function
# ---------- end vb_3 ----------
pline_3 = PolyLine(Vertices=vb_3.pts, Closed=False)

# ----
nurbs = NurbsCurve(Vertices=vb_3.pts, Degree=3, Periodic=False)  # -> flatten(Curve), Length, Domain
asymptoticcurves_2 = Curve(nurbs.Curve)
item_3 = ListItem(List=asymptoticcurves_2, Index=Slider(0, range=0..100), Wrap=True)
# Curvature visualization - osculating circles
divide = DivideCurve(Curve=item_3, Count=10, Kinks=False)  # -> Points, Tangents, Parameters

# ---- group: Osculating circles
curvature_11 = Curvature(Curve=graft(item_3), Parameter=divide.Parameters)  # -> P, K, C

# ---- group: Darboux Frames
divide_2 = DivideCurve(Curve=reparameterize(asymptoticcurves_2), Count=Slider(30, range=0..100), Kinks=False)  # -> Points, Tangents, Parameters
# Darboux Frames
# Darboux Frame consists of
# all necessary directions to
# construct:
# - asymptotic curves
# - geodesic curves
# - principal curvature curves
# 
# In this case Darboux Frame is
# created using the curve's Tangent
# vector and Binormal vector being
# the second derivative of the Tangent vector.
# Cross product of those vector is the Torsion
cdiv = Derivatives(Curve=reparameterize(graft(asymptoticcurves_2)), Parameter=divide_2.Parameters)  # -> Point, FirstDerivative, SecondDerivative
pl = ConstructPlane(Origin=divide_2.Points, XAxis=cdiv.FirstDerivative, YAxis=cdiv.SecondDerivative)

# ----
scale = Scale(Geometry=curvature_11.C, Center=divide.Points, Factor=Slider(0.09, range=0..0.1))  # -> Geometry, Transform
# If the curve is asymtotic
# the graph will align with
# the binormal vectors
crvgraph_2 = CurvatureGraph(Curve=nurbs.Curve, Density=Slider(5, range=0..100), Scale=number_slider_2)

# ---- group: Bending radiuses of the curve
darc = DeconstructArc(Arc=curvature_11.C)  # -> BasePlane, Radius, Angle
# To calculate min bending radius
# we need to generate sample points
# and see in which point the radius is
# the smallest
panel_19 = Panel(darc.Radius)

# ----
xprod = CrossProduct(VectorA=cdiv.FirstDerivative, VectorB=cdiv.SecondDerivative, Unitize=False)  # -> Vector, Length
# Round value recommended
# to compare if the surface
# is minimal (tolerance issue)
roundd = RoundToDecimalPlace(NumberX=panel_16, DecimalPlace="2", RoundType=0)  # -> Rounded, Difference
roundd_2 = RoundToDecimalPlace(NumberX=panel_15, DecimalPlace=panel_17, RoundType=0)  # -> Rounded, Difference

panel_20 = Panel(roundd.Rounded)
panel_21 = Panel(roundd_2.Rounded)
