# Grasshopper definition Day1_Ex3.gh (Grasshopper 1.0.7)
# plug-ins: Kangaroo2 Components, Karamba3D, Weaverbird

cutting_outline = Curve(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)
# OPTIshell © 2024 by Judy Curie, Szymon Loj is licensed under CC BY-NC-SA 4.0
# “© Judy Curie, Szymon Loj, 2024.
# adopted from Eike Schling
# 
# This work may be reproduced, modified, distributed, performed and displayed for any purpose, but must acknowledge “OPTIshell”.
# Copyright is retained and must be preserved. The work is provided as is; no warranty is provided, and users accept all liability.”
# Shell Analysis
split_surface = Surface(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)

# ----
# meshing
splitsrf = Surface(split_surface)
geo = Geometry(splitsrf)
untrim = Untrim(Surface=geo)
retrim = Retrim(Source=geo, Target=untrim)
edges = BrepEdges(Brep=geo)  # -> Naked, Interior, NonManifold
meshsubd = MeshFromSubD(SubD=retrim, Density=Slider(0, range=0..1))
qrsettings = QuadRemeshSettings(
    TargetCount="600",
    AdaptiveSize=Slider(100, range=0..100),
    AdaptiveCount=Toggle(True),
    HardEdges=False,
    SeamEdges="2",
    Symmetry="0",
    GuideCurves=2)
turn = MeshTurn(Mesh=meshsubd)
geo_2 = Geometry(splitsrf)
qrmesh = QuadRemesh(Mesh=turn, Guides=edges.Naked, Settings=qrsettings)
mesh = Mesh(qrmesh)
facen = FaceNormals(Mesh=mesh)  # -> Centers, Normals
srf_cp = SurfaceClosestPoint(Point=facen.Centers, Surface=geo_2)  # -> Point, UVPoint, Distance
smaller = SmallerThan(FirstNumber=Slider(0.02, range=0..0.1), SecondNumber=srf_cp.Distance)  # -> SmallerThan, OrEqualTo
cullf = CullFaces(Mesh=mesh, Pattern=smaller.OrEqualTo)
mesh_2 = Mesh(cullf)

mesh_3 = Mesh(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)
mesh_4 = Mesh(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)
mesh_5 = Mesh(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)
pt = Point([Point(-0.4962019324, 4.83746624, -2.600001335), Point(-0.685885191, 4.591359138, -2.599952459), Point(-0.8755685091, 4.345252514, -2.599903584), Point(-1.071744442, 4.143369675, -2.599829197), Point(-1.267920494, 3.941487074, -2.59975481), Point(-1.487960577, 3.766694069, -2.59968853)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])
mesh_6 = Mesh(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)

shell_h_cm = Slider(0.1, range=0..1)
list = ValueList({"LC0": 0, "LC1": 1}, selected="LC1")

material_data_tree = Data(Tree({0;0}: [875], {0;1}: ["birch"], {0;2}: [75.8], {0;3}: [0.3], {0;4}: [1.4], {0;5}: [6.67], {0;6}: [3.995]))
mesh_7 = Mesh(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)
geo_3 = Geometry([<brep referenced from the Rhino model> x3])

# ----
# loads - LC0
number_slider = Slider(1.4, range=0..10)
factor = Number(number_slider)
Z = UnitZ(Factor="-1.0")
multiplication = Multiplication(A=Z, B=factor)
loads = LoadsKaramba3D(Vector=multiplication, LCase="0", mode="Gravity")

Z_2 = UnitZ(Factor=1)
Y = UnitY(Factor=1)
X = UnitX(Factor=1)
number_slider_2 = Slider(0.1, range=0..0.1)

number_slider_3 = Slider(0.1, range=0..0.1)
number_slider_4 = Slider(0.005, range=0..0.01)
panel = Panel("""2.83
when
cantelivered
d= l/150
L = 4.25m """)
list_2 = ValueList({"1 to 10": 0.1, "1:1": 1}, selected="1 to 10")
scale = Scale(Geometry=mesh_7, Center=Point(0, 0, 0), Factor=list_2)  # -> Geometry, Transform
scale_2 = Scale(Geometry=geo_3, Center=Point(0, 0, 0), Factor=list_2)  # -> Geometry, Transform
wbtriangles = WeaverbirdsSplitTrianglesSubdivision(MeshCurves=scale.Geometry, Level="2")
geo_4 = Geometry(scale_2.Geometry)
# resulting points
mesh_8 = Mesh(wbtriangles)
lc0 = LoadKaramba3D(loads)
lc0_2 = LoadKaramba3D(lc0)

scale_3 = Scale(Geometry=pt, Center=Point(0, 0, 0), Factor=list_2)  # -> Geometry, Transform
pt_2 = Point(scale_3.Geometry)

multiplication_2 = Multiplication(A=number_slider_2, B=Slider(0.01, range=0..0.01))
area = Area(Geometry=mesh_8)  # -> Area, Centroid
multiplication_3 = Multiplication(A=area.Area, B=multiplication_2)
panel_2 = Panel(area.Area)
volume = Panel(multiplication_3)

# ----
# outline supports
medges = MeshEdges(Mesh=mesh_8)  # -> NakedEdges, InteriorEdges, NonManifoldEdges
crv = Curve(medges.NakedEdges)
end = EndPoints(Curve=crv)  # -> Start, End
rdpoints = RemoveDuplicatePointsKaramba3D(Point=[end.Start, end.End], LimitDistance=0.005)  # -> OutPoint, Info, Indexes
pt_3 = Point(rdpoints.OutPoint)

# ----
# bottom edge beam supports
demesh = DeconstructMesh(Mesh=mesh_8)  # -> Vertices, Faces, Colours, Normals
brepsinc = PointInBreps(Brep=graft(geo_4), Point=demesh.Vertices, Strict=False)  # -> Inside, Index
dispatch = Dispatch(List=demesh.Vertices, DispatchPattern=brepsinc.Index)  # -> ListA, ListB
rdpoints_2 = RemoveDuplicatePointsKaramba3D(Point=flatten(dispatch.ListB), LimitDistance=0.005)  # -> OutPoint, Info, Indexes
pt_4 = Point(rdpoints_2.OutPoint)

# ----
# shell
karamba_material = KarambaMaterial(material_data_tree=material_data_tree)
cross_section = CrossSectionKaramba3D(FamilyNameOfCrossSection="DefaultCroSec", Material=karamba_material, Height_cm=number_slider_2, mode="Shell - Const")
meshtoshell = MeshToShellKaramba3D(Mesh=mesh_8, CrossSection=cross_section, LimitDistance_m=0.005)  # -> Element, Points, Info

mesh_for_wind = Mesh(mesh_8)

# ----
# loads - LC1
panel_3 = Panel("""70mph = 31n/s
=  577Pa =  0.577 Kn/m2""")
panel_4 = Panel("""96km/h = 26m/s
=  484Pa =  0.484 Kn/m2""")
loadcase1 = LoadCase1(
    wind_pressure_kn_m2="0.484",
    mesh_laths_for_wind=mesh_for_wind,
    w_factor=Slider(1, range=0..10),
    d_factor=Slider(0.9, range=0..1))
lc1 = LoadKaramba3D(loadcase1)

crv_2 = Curve(medges.InteriorEdges)
disassemble = DisassembleMaterialKaramba3D(Material=karamba_material)  # -> Material, TypeOfMaterial, FamilyNameOfMaterial, NameOfMaterial, ElemIdentifiers, Color, YoungsModulusKNCm2Dir12, InPlaneShearModulus_kN_cm2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
panel_5 = Panel(disassemble.NameOfMaterial)
panel_6 = Panel(disassemble.YoungsModulusKNCm2Dir12)
panel_7 = Panel(disassemble.InPlaneShearModulus_kN_cm2)
pt_5 = Point(pt_2)
circle = CircleCNR(Center=pt_5, Normal=graft([X, Z_2, Y]), Radius=Slider(0.05, range=0..0.1))
line = LineSDL(Start=pt_5, Direction=graft([Z_2, Y, X]), Length=Slider(0.15, range=0..1))

fsim = FindSimilarMember(Data=pt_5, Set=meshtoshell.Points)  # -> Hit, Index
rdpoints_3 = RemoveDuplicatePointsKaramba3D(Point=fsim.Hit, LimitDistance=0.005)  # -> OutPoint, Info, Indexes
supp = SupportKaramba3D(PosInd=rdpoints_3.OutPoint, menu=[buttons(on, on, on, off, on, on)])

lc1_2 = LoadKaramba3D(lc1)

filter = StreamFilter(Gate=list, Stream0=lc0, Stream1=lc1_2)

assemble = AssembleModelKaramba3D(Elem=meshtoshell.Element, Support=supp, Load=filter, LimitDistance_m=0.005)  # -> Model, Info, Mass_kg, CenterOfGravity, LoadCaseNames

analyze = AnalyzeKaramba3D(Model=assemble.Model)  # -> CalculatedModel, MaximumDisplacement_cm, ResultingForceOfGravity_kN, ElasticEnergyChange_kNm
analyzethii = AnalyzeThIIKaramba3D(Model=assemble.Model, LoadCase="-1", RTolerance=1e-07, MaxIterations=50, NoTensionalNII=False)  # -> CalculatedModel, MaximumDisplacement_cm, ResultingForceOfGravity_kN, ElasticEnergyChange_kNm
modelview = ModelViewKaramba3D(Model=assemble.Model, ResultFactors=1, ResultCase=-1)  # -> Model, DeformedMesh, DeformedAxes, DeformedModel
utilization = UtilizationOfElementsKaramba3D(AnalyzedModel=analyze.CalculatedModel, mode="Shells")  # -> AnalyzedModel, Utilization
bmodes = BucklingModesKaramba3D(Model=analyzethii.CalculatedModel, FromIndex=1, NumberOfModes=1, MaximumNumberOfIterations=300, Epsilon=1e-07)  # -> ModelWithBucklingModesAsLoadCaseResults, BucklingLoadFactors
shellview = ShellViewKaramba3D(Model=analyze.CalculatedModel, IndexOfLayer=0)  # -> Model, MeshesOfRenderedShells, LegendColors, LegendTags
legend = Legend(Colour=shellview.LegendColors, Tags=shellview.LegendTags, LegendType=1)

shellview_2 = ShellViewKaramba3D(Model=analyze.CalculatedModel, IndexOfLayer=0)  # -> Model, MeshesOfRenderedShells, LegendColors, LegendTags
legend_2 = Legend(Colour=shellview_2.LegendColors, Tags=shellview_2.LegendTags, LegendType=1)
panel_8 = Panel(shellview_2.LegendTags)
item = ListItem(List=panel_8, Index="1", Wrap=True)  # -> Item1, Item
item_2 = ListItem(List=panel_8, Index="11", Wrap=True)  # -> Item1, Item
python = GhPythonScript(x=item.Item, y=item_2.Item)  # -> out, a, maxUtil
# ---------- python: Python ----------
__author__ = "judyt"
__version__ = "2024.02.27"

import rhinoscriptsyntax as rs


x = x.replace(" ","")
y = y.replace(" ","")

a = x + " - " + y
# ---------- end python ----------
blfacs = Panel(bmodes.BucklingLoadFactors)
utilization_2 = Panel(python.a)
displacement = Panel(analyze.MaximumDisplacement_cm)
merge = Merge(Data1=displacement, Data2=blfacs, Data3=utilization_2)
panel_9 = Panel(merge)

# ==== cluster LoadCase1
wind_pressure_kn_m2 = ClusterInput()
mesh_laths_for_wind = ClusterInput()
d_factor = ClusterInput()
w_factor = ClusterInput()
wind_pressure_kn_m2_2 = Number(wind_pressure_kn_m2)
mesh_laths_for_wind_2 = Mesh(mesh_laths_for_wind)
w_factor_2 = Number(w_factor)
d_factor_2 = Number(d_factor)
X = UnitX(Factor=wind_pressure_kn_m2_2)
Z = UnitZ(Factor="-1.0")
multiplication = Multiplication(A=X, B=w_factor_2)
multiplication_2 = Multiplication(A=Z, B=d_factor_2)

# ----
# loads - LC1
loads = LoadsKaramba3D(
    Vector=multiplication,
    Mesh=mesh_laths_for_wind_2,
    LCase="1",
    mode="MeshLoad -Const.",
    menu=[buttons(off, off, on), buttons(on, on)])
loads_2 = LoadsKaramba3D(Vector=multiplication_2, LCase="1", mode="Gravity")

lc1 = LoadKaramba3D(flatten([loads_2, loads]))
lc1_2 = ClusterOutput(lc1)

# ==== cluster KarambaMaterial
material_data_tree = ClusterInput()
material_data_tree_2 = Data(material_data_tree)
matselect = MaterialSelectionKaramba3D(menu=[dropdown(4), dropdown(1)])

# ----
# material definition
bang = ExplodeTree(Data=material_data_tree_2)  # -> Branch0, Branch1, Branch2, Branch3, Branch4, Branch5, Branch6
shear_modulus_kn_cm2 = Number(bang.Branch2)
youngs_modulus_kn_cm2 = Number(bang.Branch0)
density_kn_m3 = Number(bang.Branch5)
poisson_ratio = Number(bang.Branch3)
radius_cm = Number(bang.Branch4)
fy_kn_cm2 = Number(bang.Branch6)
material_name = Text(bang.Branch1)

disassemble = DisassembleMaterialKaramba3D(Material=matselect)  # -> Material, TypeOfMaterial, FamilyNameOfMaterial, NameOfMaterial, ElemIdentifiers, Color, YoungsModulusKNCm2Dir12, InPlaneShearModulus_kN_cm2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
panel = Panel(material_name)
matprops = MaterialPropertiesKaramba3D(
    FamilyOfMaterial="wood",
    Name=panel,
    Color=disassemble.Color,
    YoungsModulus_kN_cm2="910",
    InPlaneShearModulus_kN_cm2=disassemble.InPlaneShearModulus_kN_cm2,
    TransverseShearModulus_kN_cm2=disassemble.TransverseShearModulusKNCm2Dir12,
    SpecificWeight_kN_m3="4.5",
    CoefficientOfThermalExpansion_1_C=disassemble.CoefficientOfThermalExpansion1CDir12,
    YieldStrength_kN_cm2=Slider(3.8, range=0..10),
    mode="Isotrop")
material = MaterialKaramba3D(matprops)
material_2 = ClusterOutput(material)
