# Grasshopper definition Day2_Ex1.gh (Grasshopper 1.0.7)
# plug-ins: Bifocals, Pufferfish

# OPTIshell © 2024 by Judy Curie, Szymon Loj is licensed under CC BY-NC-SA 4.0
# “© Judy Curie, Szymon Loj, 2024.
# adopted from Eike Schling
# 
# This work may be reproduced, modified, distributed, performed and displayed for any purpose, but must acknowledge “OPTIshell”.
# Copyright is retained and must be preserved. The work is provided as is; no warranty is provided, and users accept all liability.”
minimal_surface = Surface(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)

minimal_surface_2 = Surface(reparameterize(minimal_surface))

# ---- group: No of StartingPoints
list = ValueList({"39", "45", "51", "57", "63"}, selected="51")

# ----
split_surface = Surface(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)
cutting_outline = Curve(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)

asymptotic_crv_63 = Curve(reparameterize(flatten([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])))  # disabled
asymptotic_crv_39 = Curve(reparameterize(flatten([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])))  # disabled
asymptotic_crv_45 = Curve(reparameterize(flatten([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])))  # disabled
asymptotic_crv_51 = Curve(reparameterize(flatten([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])))  # disabled
asymptotic_crv_57 = Curve(reparameterize(flatten([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])))  # disabled

# ----
# Asymptotic & Principal
debrep = DeconstructBrep(Brep=minimal_surface_2)  # -> Faces, Edges, Vertices
item = ListItem(List=debrep.Edges, Index=0, Wrap=True)  # -> Item, Item1
divide = DivideCurve(Curve=item.Item1, Count=list, Kinks=False)  # -> Points, Tangents, Parameters
pt = Point(divide.Points)
srf_cp = SurfaceCP(Point=pt, Surface=minimal_surface_2)  # -> Point, UVPoint, Distance

# ----
# Principal Curvature Lines Working
# (original Rutten, improved by Gregson- different algoritms and updated VB script )
# srf: Surface to sample
# 
# uv: UV point on surface for PrinCrv intersection
# 
# accuracy: Distance between sample-points
# 
# angle: Angle (in radians) to deviate from maximum principle curvature.
# 
# max: If True, the maximum principal curvature will be traced, if False, then the minimum principal curvature will be traced.
# Principal Curvature Lines
# Improved
angle = Slider(0, range=-90..90)
panel = Panel("""True
False""")
list_2 = ValueList({"Euler": 1, "Modified Euler": 2, "RK4": 3}, selected="RK4")
rad = Radians(Degrees=angle)
vb = VBScript(srf=minimal_surface_2, uv=srf_cp.UVPoint, accuracy=Slider(0.1, range=0..10), angle=rad, max=graft(panel), alg=list_2)  # -> out, simplify(pts); inputs srf: Surface, uv: Point3d
# ---------- vb: VB usings ----------
Imports System.IO
Imports System.Linq
Imports System.Data
Imports System.Drawing
Imports System.Reflection
Imports System.Windows.Forms
Imports System.Xml
Imports System.Xml.Linq
Imports Microsoft.VisualBasic
Imports System.Runtime.InteropServices

Imports Rhino.DocObjects
Imports Rhino.Collections
Imports GH_IO
Imports GH_IO.Serialization
# ---------- vb: VB ----------
    If (srf Is Nothing) Then Return
    If (Not uv.IsValid) Then Return

    'Limit the accuracy to the document tolerance.
    accuracy = Math.Max(accuracy, doc.ModelAbsoluteTolerance)

    'Declare our list of samples.
    Dim dir0 As List(Of Point3d) = SampleCurvature(srf, uv, accuracy, max, angle, alg)
    Dim dir1 As List(Of Point3d) = SampleCurvature(srf, uv, accuracy, max, angle + Math.PI, alg)

    'Remove the first point in dir1 as it's a duplicate
    dir1.RemoveAt(0)
    dir1.Reverse()

    dir1.AddRange(dir0)
    pts = dir1
# ---------- vb: VB additional code ----------
  Private Function SampleCurvature(ByVal srf As Surface, ByVal uv As Point3d, ByVal accuracy As Double, ByVal max As Boolean, ByVal angle As Double, ByVal alg As Integer) As List(Of Point3d)
    Dim p As Point3d = uv
    Dim U As Interval = srf.Domain(0)
    Dim V As Interval = srf.Domain(1)

    Dim samples As New List(Of Point3d)
    Do
      'Add the current point.
      samples.Add(srf.PointAt(p.X, p.Y))

      '####################################
      '##### Euler/Modified Euler/RK4 #####
      '####################################
      Dim dir As Vector3D

      Select Case alg
        Case 1
          dir = Euler(srf, p, max, angle, accuracy, samples)
        Case 2
          dir = ModEuler(srf, p, max, angle, accuracy, samples)
        Case 3
          dir = RK4(srf, p, max, angle, accuracy, samples)
        Case Else
          Print("Choose a 'alg' number from 1 to 3")
      End Select

      If (IsNothing(dir)) Then Exit Do

      Dim s, t As Double
      Dim pt As Point3d = samples(samples.Count - 1) + dir
      If (Not srf.ClosestPoint(pt, s, t)) Then Exit Do

      '##################
      '##### Checks #####
      '##################
      'Abort if we've added more than 10,000 samples.
      If (samples.Count > 9999) Then Exit Do

      'Abort if we've wandered beyond the surface edge.
      If (Not U.IncludesParameter(s, True)) Then Exit Do
      If (Not V.IncludesParameter(t, True)) Then Exit Do

      'Abort if the new point is basically the same as the old point.
      If (Math.Abs(p.X - s) < 1e-12) AndAlso (Math.Abs(p.Y - t) < 1e-12) Then Exit Do

      p.X = s
      p.Y = t
    Loop

    Return samples
  End Function

  Private Function GetDir(ByVal srf As Surface, ByVal p As Point3d, ByVal max As Boolean, ByVal angle As Double, ByVal h As Double, ByVal PrevDir As Vector3d) As Vector3d
    'Get the curvature at the current point.
    Dim crv As SurfaceCurvature = srf.CurvatureAt(p.X, p.Y)
    If (crv Is Nothing) Then Return Nothing

    'Get the maximum principal direction.
    Dim dir As Vector3d
    If (crv.Kappa(0) > crv.Kappa(1)) Then
      If (max) Then
        dir = crv.Direction(0)
      Else
        dir = crv.Direction(1)
      End If
    Else
      If (max) Then
        dir = crv.Direction(1)
      Else
        dir = crv.Direction(0)
      End If
    End If

    dir.Rotate(angle, crv.Normal)

    If (Not dir.IsValid) Then Return Nothing
    If (Not dir.Unitize()) Then Return Nothing

    'Scale the direction vector to match our accuracy.
    dir *= h

    'Flip the direction 180 degrees if it seems to be going backwards
    If (Not IsNothing(PrevDir)) Then
      If (dir.IsParallelTo(PrevDir, 0.5 * Math.PI) < 0) Then
        dir.Reverse()
      End If
    End If

    Return dir
  End Function

  Private Function Euler(ByVal srf As Surface, ByVal p As Point3d, ByVal max As Boolean, ByVal angle As Double, ByVal h As Double, ByVal samples As List(Of Point3d)) As Vector3d
    Dim N As Integer = samples.Count
    Dim PrevDir As Vector3d
    If (N > 1) Then
      PrevDir = samples(N - 1) - samples(N - 2)
    End If

    Dim dir As Vector3D = GetDir(srf, p, max, angle, h, PrevDir)
    If (IsNothing(dir)) Then Return Nothing

    Return dir
  End Function

  Private Function ModEuler(ByVal srf As Surface, ByVal p As Point3d, ByVal max As Boolean, ByVal angle As Double, ByVal h As Double, ByVal samples As List(Of Point3d)) As Vector3d
    Dim N As Integer = samples.Count
    Dim PrevDir As Vector3d
    If (N > 1) Then
      PrevDir = samples(N - 1) - samples(N - 2)
    End If

    Dim dir1 As Vector3D = GetDir(srf, p, max, angle, h, PrevDir)
    If (IsNothing(dir1)) Then Return Nothing

    'Move the last point in the list along the curvature direction.
    Dim pt As Point3d = samples(samples.Count - 1) + dir1

    Dim s, t As Double
    If (Not srf.ClosestPoint(pt, s, t)) Then Return Nothing
    pt.X = s
    pt.Y = t

    Dim dir2 As Vector3D = GetDir(srf, pt, max, angle, h, dir1)
    If (IsNothing(dir2)) Then Return Nothing

    Dim dir As Vector3D = (dir1 + dir2) * 0.5
    Return dir
  End Function

  Private Function RK4(ByVal srf As Surface, ByVal p As Point3d, ByVal max As Boolean, ByVal angle As Double, ByVal h As Double, ByVal samples As List(Of Point3d)) As Vector3d
    Dim N As Integer = samples.Count
    Dim PrevDir As Vector3d
    If (N > 1) Then
      PrevDir = samples(N - 1) - samples(N - 2)
    End If

    Dim K1 As Vector3D = GetDir(srf, p, max, angle, h, PrevDir)
    If (IsNothing(K1)) Then Return Nothing

    'Move the last point in the list along the curvature direction.
    Dim pt1 As Point3d = samples(samples.Count - 1) + K1 * 0.5

    Dim s, t As Double
    If (Not srf.ClosestPoint(pt1, s, t)) Then Return Nothing
    pt1.X = s
    pt1.Y = t

    Dim K2 As Vector3D = GetDir(srf, pt1, max, angle, h, K1)
    If (IsNothing(K2)) Then Return Nothing

    Dim pt2 As Point3d = samples(samples.Count - 1) + K2 * 0.5

    If (Not srf.ClosestPoint(pt2, s, t)) Then Return Nothing
    pt2.X = s
    pt2.Y = t

    Dim K3 As Vector3D = GetDir(srf, pt2, max, angle, h, K1)
    If (IsNothing(K3)) Then Return Nothing

    Dim pt3 As Point3d = samples(samples.Count - 1) + K3

    If (Not srf.ClosestPoint(pt3, s, t)) Then Return Nothing
    pt3.X = s
    pt3.Y = t

    Dim K4 As Vector3D = GetDir(srf, pt3, max, angle, h, K1)
    If (IsNothing(K4)) Then Return Nothing

    Dim dir As Vector3D = 1 / 6 * (K1 + 2 * K2 + 2 * K3 + K4)
    Return dir
  End Function
# ---------- end vb ----------
pline = PolyLine(Vertices=vb.pts, Closed=False)

# ----
# Asymptotic Lines
# faster (no data output)
slider = Slider(0.02, range=0..10)
angle_2 = Slider(0, range=-90..90)
panel_2 = Panel("""True
False""")
rad_2 = Radians(Degrees=angle_2)
vb_2 = VBScript(srf=minimal_surface_2, uv=srf_cp.UVPoint, accuracy=slider, angle=rad_2, max=graft(panel_2))  # -> out, pts; inputs srf: Surface, uv: Point3d
# ---------- vb_2: VB ----------
    If (srf Is Nothing) Then Return
    If (Not uv.IsValid) Then Return

    'Limit the accuracy to the document tolerance.
    accuracy = Math.Max(accuracy, doc.ModelAbsoluteTolerance)

    'Declare our list of samples.
    Dim dir0 As List(Of Point3d) = SampleCurvature(srf, uv, accuracy, max, angle)
    Dim dir1 As List(Of Point3d) = SampleCurvature(srf, uv, accuracy, max, angle + Math.PI)

    'Remove the first point in dir1 as it's a duplicate
    dir1.RemoveAt(0)
    dir1.Reverse()

    dir1.AddRange(dir0)
    pts = dir1
# ---------- vb_2: VB additional code ----------
  Private Function SampleCurvature(ByVal srf As Surface, ByVal uv As Point3d, ByVal accuracy As Double, ByVal max As Boolean, ByVal angle As Double) As List(Of Point3d)
    Dim p As Point3d = uv
    Dim U As Interval = srf.Domain(0)
    Dim V As Interval = srf.Domain(1)

    Dim samples As New List(Of Point3d)
    Do
      'Abort if we've added more than 10,000 samples
      If (samples.Count > 10000) Then Exit Do

      'Get the curvature at the current point
      Dim crv As SurfaceCurvature = srf.CurvatureAt(p.X, p.Y)
      If (crv Is Nothing) Then Exit Do

      'Add the current point
      samples.Add(srf.PointAt(p.X, p.Y))

      'Get the maximum principal direction & values
      Dim dir As Vector3d
      Dim k1 = 0
      Dim k2 = 0
      If (crv.Kappa(0) > crv.Kappa(1)) Then
        If (max) Then
          dir = crv.Direction(0)
          k1 = crv.Kappa(0)
          k2 = crv.Kappa(1)
        Else
          dir = crv.Direction(1)
          k1 = crv.Kappa(1)
          k2 = crv.Kappa(0)
        End If
      Else
        If (max) Then
          dir = crv.Direction(1)
          k1 = crv.Kappa(1)
          k2 = crv.Kappa(0)
        Else
          dir = crv.Direction(0)
          k1 = crv.Kappa(0)
          k2 = crv.Kappa(1)
        End If
      End If


      'check if you are on an anticlastic surface, if not: Exit
      If (k1 * k2 > 0) Then Exit Do

      'Calculate alpha, which is the deviation between A-direction to PC-direction

      Dim alpha1 As Double
      Dim alpha2 As Double
      alpha1 = (2 * Math.ATan(Math.Sqrt((2 * Math.Sqrt(k2 * ( -(k1 - k2))) + k1 - (2 * k2)) / k1)))
      alpha2 = (2 * Math.ATan(Math.Sqrt((-2 * Math.Sqrt(k2 * ( -(k1 - k2))) + k1 - (2 * k2)) / k1)))

      'apply aplpha to the PC-direction to get A-direction
      If (max) Then
        dir.Rotate(-alpha1, crv.Normal)
      Else
        dir.Rotate(-alpha2, crv.Normal)
      End If


      'optional additional angle!
      dir.Rotate(angle, crv.Normal)

      If (Not dir.IsValid) Then Exit Do
      If (Not dir.Unitize()) Then Exit Do

      'Scale the direction vector to match our accuracy.
      dir *= accuracy

      'Flip the direction 180 degrees if it seems to be going backwards
      Dim N As Integer = samples.Count
      If (N > 1) Then
        If (dir.IsParallelTo(samples(N - 1) - samples(N - 2), 0.5 * Math.PI) < 0) Then
          dir.Reverse()
        End If
      End If

      'Move the last point in the list along the curvature direction.
      Dim pt As Point3d = samples(samples.Count - 1) + dir

      Dim s, t As Double
      If (Not srf.ClosestPoint(pt, s, t)) Then Exit Do

      'Abort if we've wandered beyond the surface edge.
      If (Not U.IncludesParameter(s, True)) Then Exit Do
      If (Not V.IncludesParameter(t, True)) Then Exit Do

      'Abort if the new point is basically the same as the old point.
      If (Math.Abs(p.X - s) < 1e-12) AndAlso (Math.Abs(p.Y - t) < 1e-12) Then Exit Do

      p.X = s
      p.Y = t
    Loop

    Return samples
  End Function
# ---------- end vb_2 ----------
pline_2 = PolyLine(Vertices=vb_2.pts, Closed=False)
panel_3 = Panel(vb_2.out)

reb = RebuildCurve(Curve=pline_2, Degree="3", Count=Slider(13, range=0..100), Tangents=False)
asymptotic_crv = Curve(reparameterize(flatten(pline_2)))

ccx = CurveCurve(CurveA=cutting_outline, CurveB=asymptotic_crv)  # -> Points, ParamsA, ParamsB
# CUTTING ASYMPTOTICS
shatter = Shatter(Curve=graft(asymptotic_crv), Parameters=ccx.ParamsB)
curvepoint = PointOnCurve(shatter, parameter=0.5)
srf_cp_2 = SurfaceClosestPoint(Point=curvepoint, Surface=split_surface)  # -> Point, UVPoint, Distance
panel_4 = Panel(srf_cp_2.Distance)
smaller = SmallerThan(FirstNumber=srf_cp_2.Distance, SecondNumber=Slider(0.01, range=0..0.01))  # -> SmallerThan, OrEqualTo
cull = CullPattern(List=shatter, CullPattern=smaller.SmallerThan)

grid = Curve(cull)
# 3D LATHS
minimal_surface_3 = Surface(minimal_surface)
divdist = DivideDistance(Curve=grid, Distance=Slider(0.1, range=0..0.1))  # -> Points, Tangents, Parameters
srf_cp_3 = SurfaceClosestPoint(Point=divdist.Points, Surface=minimal_surface_3)  # -> Point, UVPoint, Distance
evalsrf = EvaluateSurface(Surface=minimal_surface_3, Point=srf_cp_3.UVPoint)  # -> Point, Normal, UDirection, VDirection, Frame
neg = Negative(Value=Slider(0.1, range=0..0.1))
amp = Amplitude(Vector=evalsrf.Normal, Amplitude=Slider(0.1, range=0..0.1))
amp_2 = Amplitude(Vector=evalsrf.Normal, Amplitude=neg)
move = Move(Geometry=evalsrf.Point, Motion=amp)  # -> Geometry, Transform
move_2 = Move(Geometry=evalsrf.Point, Motion=amp_2)  # -> Geometry, Transform

amp_3 = Amplitude(Vector=evalsrf.Normal, Amplitude=Slider(0.1, range=0..0.1))
ln = Line(StartPoint=move.Geometry, EndPoint=move_2.Geometry)

loft = Loft(Curves=ln, Options={Adjust=False, Closed=False, LoftEnds=0, LoftSimp=0, LoftType=0, Rebuild=10, Refit=0.01})  # -> simplify(Loft)

# ---- group: solid from laths
multiplication = Multiplication(B=Slider(0.005, range=0..0.01))
neg_2 = Negative(Value=multiplication)
offsrf = OffsetSurface(Surface=loft, Distance=[multiplication, neg_2], BothSides=0, CreateSolid=True)
trim = TrimTree(Tree=offsrf, Depth=1)
sunion = SolidUnion(Breps=trim)

# ----
# solid laths
solid_laths = Brep(sunion)
